# Dynamo graph Выгрузка из модели.dyn (Dynamo 2.16.1.2727)

file_path = Filename(".\Analytics.xlsx")
string = StringInput("PhysicalElements")
code_block = CodeBlock { 0; }

# group: Date
year = DoubleInput(2025)
month = DoubleInput(2)
day = DoubleInput(21)

byDate = DateTime.ByDate(year=year, month=month, day=day)
physical_categories = Python(IN[0]=byDate)  # CPython3; graph output
# ---------- physical_categories.python (55 lines) ----------
import clr
clr.AddReference("RevitServices")
from RevitServices.Persistence import DocumentManager
clr.AddReference("RevitAPI")
from Autodesk.Revit.DB import *

# Получение текущего документа
doc = DocumentManager.Instance.CurrentDBDocument

report_date = IN[0]

# Функция для получения связанных моделей (Linked Models)
def get_linked_models(document):
    linked_instances = FilteredElementCollector(document).OfClass(RevitLinkInstance).ToElements()
    linked_docs = []

    for link in linked_instances:
        linked_doc = link.GetLinkDocument()
        if linked_doc:
            linked_docs.append(linked_doc)

    return linked_docs

# Функция для подсчета категорий модели (физические элементы)
def count_model_categories(document):
    model_elements = FilteredElementCollector(document).WhereElementIsNotElementType().ToElements()
    category_counts = {}

    for element in model_elements:
        category = element.Category
        if category and category.CategoryType == CategoryType.Model:
            category_name = category.Name
            if category_name in category_counts:
                category_counts[category_name] += 1
            else:
                category_counts[category_name] = 1

    return category_counts

# Получаем все связанные модели
linked_models = get_linked_models(doc)

# Заголовки для таблицы
output_data = [["Model Name", "Category", "Count", "Report Date"]]

# Подсчет категорий по каждой модели
for linked_doc in linked_models:
    model_name = linked_doc.Title  # Имя связанной модели
    category_counts = count_model_categories(linked_doc)  # Категории модели

    for category_name, count in category_counts.items():
        output_data.append([model_name, category_name, count, str(report_date)])

# Вывод результатов в формате, готовом для экспорта в Excel
OUT = output_data
# ----------------------------------------
boolean = BoolSelector(true)
exportToExcel = Data.ExportToExcel(filePath=file_path, sheetName=string, startRow=code_block, startColumn=code_block, data=physical_categories, overWrite=boolean, writeAsString=boolean)
string_2 = StringInput("KPI")
KPI = Python()  # CPython3; graph output; unwired: IN[0]
# ---------- KPI.python (58 lines) ----------
import clr
clr.AddReference("RevitServices")
from RevitServices.Persistence import DocumentManager
clr.AddReference("RevitAPI")
from Autodesk.Revit.DB import *

# Получение текущего документа
doc = DocumentManager.Instance.CurrentDBDocument

# Функция для получения связанных моделей (Linked Models)
def get_linked_models(document):
    linked_instances = FilteredElementCollector(document).OfClass(RevitLinkInstance).ToElements()
    linked_docs = []

    for link in linked_instances:
        linked_doc = link.GetLinkDocument()
        if linked_doc:
            linked_docs.append(linked_doc)

    return linked_docs

# Функция для подсчета элементов (виды, спецификации, текстовые примечания) в документе
def count_elements(document):
    views = FilteredElementCollector(document).OfClass(View).WhereElementIsNotElementType().ToElements()
    schedules = FilteredElementCollector(document).OfClass(ViewSchedule).WhereElementIsNotElementType().ToElements()
    text_notes = FilteredElementCollector(document).OfClass(TextNote).WhereElementIsNotElementType().ToElements()

    view_count = len([view for view in views if not view.IsTemplate])
    schedule_count = len(schedules)
    text_note_count = len(text_notes)

    return view_count, schedule_count, text_note_count

# Получаем все связанные модели
linked_models = get_linked_models(doc)

# Результат
results = {}

# Проходимся по всем связанным моделям и подсчитываем элементы
for linked_doc in linked_models:
    model_name = linked_doc.Title  # Имя связанной модели
    view_count, schedule_count, text_note_count = count_elements(linked_doc)  # Подсчет элементов
    results[model_name] = {
        "Views": view_count,
        "Schedules": schedule_count,
        "TextNotes": text_note_count
    }

# Преобразуем результаты для экспорта в Excel
excel_data = []
header = ["Model Name", "Category", "Count"]

for model_name, categories in results.items():
    for category, count in categories.items():
        excel_data.append([model_name, category, count])

OUT = (header, excel_data)
# ----------------------------------------
exportToExcel_2 = Data.ExportToExcel(filePath=file_path, sheetName=string_2, startRow=code_block, startColumn=code_block, data=KPI, overWrite=boolean, writeAsString=boolean)
string_3 = StringInput("AnnotationElements")
annotation_categories = Python(IN[0]=byDate)  # CPython3; graph output
# ---------- annotation_categories.python (55 lines) ----------
import clr
clr.AddReference("RevitServices")
from RevitServices.Persistence import DocumentManager
clr.AddReference("RevitAPI")
from Autodesk.Revit.DB import *

# Получение текущего документа
doc = DocumentManager.Instance.CurrentDBDocument

report_date = IN[0]

# Функция для получения связанных моделей (Linked Models)
def get_linked_models(document):
    linked_instances = FilteredElementCollector(document).OfClass(RevitLinkInstance).ToElements()
    linked_docs = []

    for link in linked_instances:
        linked_doc = link.GetLinkDocument()
        if linked_doc:
            linked_docs.append(linked_doc)

    return linked_docs

# Функция для подсчета категорий аннотаций (нефизические элементы)
def count_annotation_categories(document):
    annotation_elements = FilteredElementCollector(document).WhereElementIsNotElementType().ToElements()
    category_counts = {}

    for element in annotation_elements:
        category = element.Category
        if category and category.CategoryType == CategoryType.Annotation:
            category_name = category.Name
            if category_name in category_counts:
                category_counts[category_name] += 1
            else:
                category_counts[category_name] = 1

    return category_counts

# Получаем все связанные модели
linked_models = get_linked_models(doc)

# Заголовки для таблицы
output_data = [["Model Name", "Category", "Count", "Report Date"]]

# Подсчет категорий по каждой модели
for linked_doc in linked_models:
    model_name = linked_doc.Title  # Имя связанной модели
    category_counts = count_annotation_categories(linked_doc)  # Категории модели

    for category_name, count in category_counts.items():
        output_data.append([model_name, category_name, count, str(report_date)])

# Вывод результатов в формате, готовом для экспорта в Excel
OUT = output_data
# ----------------------------------------
exportToExcel_3 = Data.ExportToExcel(filePath=file_path, sheetName=string_3, startRow=code_block, startColumn=code_block, data=annotation_categories, overWrite=boolean, writeAsString=boolean)
